# Dynamo graph EC2_MIGUEL RODRIGUEZ_Análisis de nomenclatura de muros.dyn (Dynamo 3.6.1.9895)

file_path = Filename("D:\002. UCSUR\000. MAESTRÍA BIM\03. M03\001. IA + ANÁLISIS DE DATOS\EC2\EC2_MIGUEL RODRIGUEZ.xlsx")
string = StringInput("Análisis de muros RH")
categories = Categories("OST_Walls")
all_elements_of_category = ElementsOfCategory(Category=categories)
python_script = Python(IN[0]=all_elements_of_category)  # CPython3
# ---------- python_script.python (54 lines) ----------
import clr
clr.AddReference('RevitServices')
import RevitServices
from RevitServices.Persistence import DocumentManager

clr.AddReference('RevitAPI')
from Autodesk.Revit.DB import *

doc = DocumentManager.Instance.CurrentDBDocument

# Desenvolver los elementos de Dynamo a elementos nativos de Revit
entrada = IN[0]
if not isinstance(entrada, list):
    entrada = [entrada]
elementos = [UnwrapElement(e) for e in entrada]

registros = []

for el in elementos:
    # Tipo de muro y su nombre
    tipo = doc.GetElement(el.GetTypeId())
    nombre_tipo = tipo.get_Parameter(BuiltInParameter.SYMBOL_NAME_PARAM).AsString()

    # Nivel base del muro
    nivel_el = doc.GetElement(el.LevelId)
    nivel = nivel_el.Name if nivel_el else None

    registros.append({
        "Id": el.Id.Value,
        "Nombre": nombre_tipo,
        "Nivel": nivel
    })

# Siglas que identifican la propiedad del muro dentro del nombre de tipo
sigla_ok = "RH"
siglas_fuera_estandar = ["ST", "RF"]

for r in registros:
    nombre = r["Nombre"].strip().upper() if r["Nombre"] else ""

    if nombre == "":
        r["Estado"] = "Falta parámetro"
    elif sigla_ok in nombre:
        r["Estado"] = "OK"
    elif any(sigla in nombre for sigla in siglas_fuera_estandar):
        r["Estado"] = "Fuera de estándar"
    else:
        r["Estado"] = "Sin sigla reconocida"

encabezados = ["Id", "Nombre", "Nivel", "Estado"]
filas = [[r["Id"], r["Nombre"], r["Nivel"], r["Estado"]]
         for r in registros]

OUT = [encabezados] + filas
# ----------------------------------------
watch = Watch(python_script)
openXMLExportExcel = Data.OpenXMLExportExcel(filePath=file_path, sheetName=string, data=watch)
